# Grasshopper definition CLT_Tools_Sample.gh (Grasshopper 1.0.8)
# plug-ins: CLT_Tools

clt_handbook = CLTHandbook(Chapter=Slider(2, range=1..4))
clt_handbook_2 = CLTHandbook(Chapter=Slider(1, range=1..4))
clt_handbook_3 = CLTHandbook(Chapter=Slider(3, range=1..4))
panel = Panel(clt_handbook_2)
panel_2 = Panel(clt_handbook)
panel_3 = Panel(clt_handbook_3)

curve = Curve(<curve referenced from the Rhino model>)  # "T0.01"
curve_2 = Curve(<curve referenced from the Rhino model>)  # "T0.02"
curve_3 = Curve(<curve referenced from the Rhino model>)  # "T0.03"
curve_4 = Curve(<curve referenced from the Rhino model>)  # "T0.04"
curve_5 = Curve(<curve referenced from the Rhino model>)  # "T0.05"
curve_6 = Curve(<curve referenced from the Rhino model>)  # "T0.06"
curve_7 = Curve(<curve referenced from the Rhino model>)  # "T0.07"
curve_8 = Curve(<curve referenced from the Rhino model>)  # "T0.08"
curve_9 = Curve(<curve referenced from the Rhino model>)  # "T0.09"
curve_10 = Curve(<curve referenced from the Rhino model>)  # "T0.10"
curve_11 = Curve(<curve referenced from the Rhino model>)  # "T0.11"
curve_12 = Curve(<curve referenced from the Rhino model>)  # "T0.12"
curve_13 = Curve(<curve referenced from the Rhino model>)  # "T0.13"
curve_14 = Curve(<curve referenced from the Rhino model>)  # "T0.14"
curve_15 = Curve(<curve referenced from the Rhino model>)  # "T0.15"
curve_16 = Curve(<curve referenced from the Rhino model>)  # "T0.16"
curve_17 = Curve(<curve referenced from the Rhino model>)  # "T0.17"
curve_18 = Curve(<curve referenced from the Rhino model>)  # "T0.18"
curve_19 = Curve(<curve referenced from the Rhino model>)  # "T0.19"
number_slider = Slider(20, range=0..100)
number_slider_2 = Slider(20, range=0..100)
number_slider_3 = Slider(20, range=0..100)
number_slider_4 = Slider(20, range=0..100)
number_slider_5 = Slider(20, range=0..100)
number_slider_6 = Slider(20, range=0..100)
number_slider_7 = Slider(20, range=0..100)
number_slider_8 = Slider(20, range=0..100)
number_slider_9 = Slider(20, range=0..100)
number_slider_10 = Slider(20, range=0..100)
number_slider_11 = Slider(20, range=0..100)
number_slider_12 = Slider(20, range=0..100)
number_slider_13 = Slider(20, range=0..100)
number_slider_14 = Slider(20, range=0..100)
number_slider_15 = Slider(20, range=0..100)
number_slider_16 = Slider(20, range=0..100)
number_slider_17 = Slider(20, range=0..100)
number_slider_18 = Slider(20, range=0..100)
number_slider_19 = Slider(20, range=0..100)
boundary_surfaces = BoundarySurfaces(Edges=curve_10)
boundary_surfaces_2 = BoundarySurfaces(Edges=curve_15)
boundary_surfaces_3 = BoundarySurfaces(Edges=curve_16)
boundary_surfaces_4 = BoundarySurfaces(Edges=curve_17)
boundary_surfaces_5 = BoundarySurfaces(Edges=curve_18)
boundary_surfaces_6 = BoundarySurfaces(Edges=curve_19)
boundary_surfaces_7 = BoundarySurfaces(Edges=curve)
boundary_surfaces_8 = BoundarySurfaces(Edges=curve_2)
boundary_surfaces_9 = BoundarySurfaces(Edges=curve_3)
boundary_surfaces_10 = BoundarySurfaces(Edges=curve_4)
boundary_surfaces_11 = BoundarySurfaces(Edges=curve_5)
boundary_surfaces_12 = BoundarySurfaces(Edges=curve_6)
boundary_surfaces_13 = BoundarySurfaces(Edges=curve_7)
boundary_surfaces_14 = BoundarySurfaces(Edges=curve_8)
boundary_surfaces_15 = BoundarySurfaces(Edges=curve_9)
boundary_surfaces_16 = BoundarySurfaces(Edges=curve_11)
boundary_surfaces_17 = BoundarySurfaces(Edges=curve_12)
boundary_surfaces_18 = BoundarySurfaces(Edges=curve_13)
boundary_surfaces_19 = BoundarySurfaces(Edges=curve_14)
mesh_surface = MeshSurface(Surface=boundary_surfaces, UCount=number_slider_10, VCount=number_slider_10, Overhang=True, Equalize=False)
mesh_surface_2 = MeshSurface(Surface=boundary_surfaces_2, UCount=number_slider_15, VCount=number_slider_15, Overhang=True, Equalize=False)
mesh_surface_3 = MeshSurface(Surface=boundary_surfaces_3, UCount=number_slider_16, VCount=number_slider_16, Overhang=True, Equalize=False)
mesh_surface_4 = MeshSurface(Surface=boundary_surfaces_4, UCount=number_slider_17, VCount=number_slider_17, Overhang=True, Equalize=False)
mesh_surface_5 = MeshSurface(Surface=boundary_surfaces_5, UCount=number_slider_18, VCount=number_slider_18, Overhang=True, Equalize=False)
mesh_surface_6 = MeshSurface(Surface=boundary_surfaces_6, UCount=number_slider_19, VCount=number_slider_19, Overhang=True, Equalize=False)
mesh_surface_7 = MeshSurface(Surface=boundary_surfaces_7, UCount=number_slider, VCount=number_slider, Overhang=True, Equalize=False)
mesh_surface_8 = MeshSurface(Surface=boundary_surfaces_8, UCount=number_slider_2, VCount=number_slider_2, Overhang=True, Equalize=False)
mesh_surface_9 = MeshSurface(Surface=boundary_surfaces_9, UCount=number_slider_3, VCount=number_slider_3, Overhang=True, Equalize=False)
mesh_surface_10 = MeshSurface(Surface=boundary_surfaces_10, UCount=number_slider_4, VCount=number_slider_4, Overhang=True, Equalize=False)
mesh_surface_11 = MeshSurface(Surface=boundary_surfaces_11, UCount=number_slider_5, VCount=number_slider_5, Overhang=True, Equalize=False)
mesh_surface_12 = MeshSurface(Surface=boundary_surfaces_12, UCount=number_slider_6, VCount=number_slider_6, Overhang=True, Equalize=False)
mesh_surface_13 = MeshSurface(Surface=boundary_surfaces_13, UCount=number_slider_7, VCount=number_slider_7, Overhang=True, Equalize=False)
mesh_surface_14 = MeshSurface(Surface=boundary_surfaces_14, UCount=number_slider_8, VCount=number_slider_8, Overhang=True, Equalize=False)
mesh_surface_15 = MeshSurface(Surface=boundary_surfaces_15, UCount=number_slider_9, VCount=number_slider_9, Overhang=True, Equalize=False)
mesh_surface_16 = MeshSurface(Surface=boundary_surfaces_16, UCount=number_slider_11, VCount=number_slider_11, Overhang=True, Equalize=False)
mesh_surface_17 = MeshSurface(Surface=boundary_surfaces_17, UCount=number_slider_12, VCount=number_slider_12, Overhang=True, Equalize=False)
mesh_surface_18 = MeshSurface(Surface=boundary_surfaces_18, UCount=number_slider_13, VCount=number_slider_13, Overhang=True, Equalize=False)
mesh_surface_19 = MeshSurface(Surface=boundary_surfaces_19, UCount=number_slider_14, VCount=number_slider_14, Overhang=True, Equalize=False)

unit_y = UnitY(Factor=1)
unit_y_2 = UnitY(Factor=1)
unit_y_3 = UnitY(Factor=1)
unit_y_4 = UnitY(Factor=1)
unit_y_5 = UnitY(Factor=1)
unit_y_6 = UnitY(Factor=1)
unit_y_7 = UnitY(Factor=1)
unit_y_8 = UnitY(Factor=1)
unit_y_9 = UnitY(Factor=1)
unit_y_10 = UnitY(Factor=1)
unit_y_11 = UnitY(Factor=1)
unit_y_12 = UnitY(Factor=1)
unit_y_13 = UnitY(Factor=1)
unit_y_14 = UnitY(Factor=1)
unit_y_15 = UnitY(Factor=1)
unit_y_16 = UnitY(Factor=1)
unit_y_17 = UnitY(Factor=1)
unit_y_18 = UnitY(Factor=1)
unit_y_19 = UnitY(Factor=1)
panel_4 = Panel("""0
90
0
90
0""")
panel_5 = Panel("""0
90
0
90
0""")
panel_6 = Panel("""0
90
0
90
0""")
panel_7 = Panel("""0
90
0
90
0""")
panel_8 = Panel("""0
90
0
90
0""")
panel_9 = Panel("""0
90
0
90
0""")
panel_10 = Panel("""0
90
0
90
0""")
panel_11 = Panel("""0
90
0
90
0""")
panel_12 = Panel("""0
90
0
90
0""")
panel_13 = Panel("""0
90
0
90
0""")
panel_14 = Panel("""0
90
0
90
0""")
panel_15 = Panel("""0
90
0
90
0""")
panel_16 = Panel("""0
90
0
90
0""")
panel_17 = Panel("""0
90
0
90
0""")
panel_18 = Panel("""0
90
0
90
0""")
panel_19 = Panel("""0
90
0
90
0""")
panel_20 = Panel("""0
90
0
90
0""")
panel_21 = Panel("""0
90
0
90
0""")
panel_22 = Panel("""0
90
0
90
0""")
panel_23 = Panel("""40
40
40
40
40""")
panel_24 = Panel("""40
40
40
40
40""")
panel_25 = Panel("""40
40
40
40
40""")
panel_26 = Panel("""40
40
40
40
40""")
panel_27 = Panel("""40
40
40
40
40""")
panel_28 = Panel("""40
40
40
40
40""")
panel_29 = Panel("""40
40
40
40
40""")
panel_30 = Panel("""40
40
40
40
40""")
panel_31 = Panel("""40
40
40
40
40""")
panel_32 = Panel("""40
40
40
40
40""")
panel_33 = Panel("""40
40
40
40
40""")
panel_34 = Panel("""40
40
40
40
40""")
panel_35 = Panel("""40
40
40
40
40""")
panel_36 = Panel("""40
40
40
40
40""")
panel_37 = Panel("""40
40
40
40
40""")
panel_38 = Panel("""40
40
40
40
40""")
panel_39 = Panel("""40
40
40
40
40""")
panel_40 = Panel("""40
40
40
40
40""")
panel_41 = Panel("""40
40
40
40
40""")
createelement = CreateElement(
    Mesh=mesh_surface,
    Identifier="T0.10",
    MaterialName="C24",
    LayersThickness=panel_32,
    LayersOrientation=panel_13,
    MainOrientation=unit_y_10)  # -> ElementS, Info, Center, MainFace
createelement_2 = CreateElement(
    Mesh=mesh_surface_2,
    Identifier="T0.15",
    MaterialName="C24",
    LayersThickness=panel_37,
    LayersOrientation=panel_18,
    MainOrientation=unit_y_15)  # -> ElementS, Info, Center, MainFace
createelement_3 = CreateElement(
    Mesh=mesh_surface_3,
    Identifier="T0.16",
    MaterialName="C24",
    LayersThickness=panel_38,
    LayersOrientation=panel_19,
    MainOrientation=unit_y_16)  # -> ElementS, Info, Center, MainFace
createelement_4 = CreateElement(
    Mesh=mesh_surface_4,
    Identifier="T0.17",
    MaterialName="C24",
    LayersThickness=panel_39,
    LayersOrientation=panel_20,
    MainOrientation=unit_y_17)  # -> ElementS, Info, Center, MainFace
createelement_5 = CreateElement(
    Mesh=mesh_surface_5,
    Identifier="T0.18",
    MaterialName="C24",
    LayersThickness=panel_40,
    LayersOrientation=panel_21,
    MainOrientation=unit_y_18)  # -> ElementS, Info, Center, MainFace
createelement_6 = CreateElement(
    Mesh=mesh_surface_6,
    Identifier="T0.19",
    MaterialName="C24",
    LayersThickness=panel_41,
    LayersOrientation=panel_22,
    MainOrientation=unit_y_19)  # -> ElementS, Info, Center, MainFace
createelement_7 = CreateElement(
    Mesh=mesh_surface_7,
    Identifier="T0.01",
    MaterialName="C24",
    LayersThickness=panel_23,
    LayersOrientation=panel_4,
    MainOrientation=unit_y)  # -> ElementS, Info, Center, MainFace
createelement_8 = CreateElement(
    Mesh=mesh_surface_8,
    Identifier="T0.02",
    MaterialName="C24",
    LayersThickness=panel_24,
    LayersOrientation=panel_5,
    MainOrientation=unit_y_2)  # -> ElementS, Info, Center, MainFace
createelement_9 = CreateElement(
    Mesh=mesh_surface_9,
    Identifier="T0.03",
    MaterialName="C24",
    LayersThickness=panel_25,
    LayersOrientation=panel_6,
    MainOrientation=unit_y_3)  # -> ElementS, Info, Center, MainFace
createelement_10 = CreateElement(
    Mesh=mesh_surface_10,
    Identifier="T0.04",
    MaterialName="C24",
    LayersThickness=panel_26,
    LayersOrientation=panel_7,
    MainOrientation=unit_y_4)  # -> ElementS, Info, Center, MainFace
createelement_11 = CreateElement(
    Mesh=mesh_surface_11,
    Identifier="T0.05",
    MaterialName="C24",
    LayersThickness=panel_27,
    LayersOrientation=panel_8,
    MainOrientation=unit_y_5)  # -> ElementS, Info, Center, MainFace
createelement_12 = CreateElement(
    Mesh=mesh_surface_12,
    Identifier="T0.06",
    MaterialName="C24",
    LayersThickness=panel_28,
    LayersOrientation=panel_9,
    MainOrientation=unit_y_6)  # -> ElementS, Info, Center, MainFace
createelement_13 = CreateElement(
    Mesh=mesh_surface_13,
    Identifier="T0.07",
    MaterialName="C24",
    LayersThickness=panel_29,
    LayersOrientation=panel_10,
    MainOrientation=unit_y_7)  # -> ElementS, Info, Center, MainFace
createelement_14 = CreateElement(
    Mesh=mesh_surface_14,
    Identifier="T0.08",
    MaterialName="C24",
    LayersThickness=panel_30,
    LayersOrientation=panel_11,
    MainOrientation=unit_y_8)  # -> ElementS, Info, Center, MainFace
createelement_15 = CreateElement(
    Mesh=mesh_surface_15,
    Identifier="T0.09",
    MaterialName="C24",
    LayersThickness=panel_31,
    LayersOrientation=panel_12,
    MainOrientation=unit_y_9)  # -> ElementS, Info, Center, MainFace
createelement_16 = CreateElement(
    Mesh=mesh_surface_16,
    Identifier="T0.11",
    MaterialName="C24",
    LayersThickness=panel_33,
    LayersOrientation=panel_14,
    MainOrientation=unit_y_11)  # -> ElementS, Info, Center, MainFace
createelement_17 = CreateElement(
    Mesh=mesh_surface_17,
    Identifier="T0.12",
    MaterialName="C24",
    LayersThickness=panel_34,
    LayersOrientation=panel_15,
    MainOrientation=unit_y_12)  # -> ElementS, Info, Center, MainFace
createelement_18 = CreateElement(
    Mesh=mesh_surface_18,
    Identifier="T0.13",
    MaterialName="C24",
    LayersThickness=panel_35,
    LayersOrientation=panel_16,
    MainOrientation=unit_y_13)  # -> ElementS, Info, Center, MainFace
createelement_19 = CreateElement(
    Mesh=mesh_surface_19,
    Identifier="T0.14",
    MaterialName="C24",
    LayersThickness=panel_36,
    LayersOrientation=panel_17,
    MainOrientation=unit_y_14)  # -> ElementS, Info, Center, MainFace

curve_20 = Curve(<curve referenced from the Rhino model>)  # "M0.01"
m0_02a = Curve(<curve referenced from the Rhino model>)
m0_02b = Curve(<curve referenced from the Rhino model>)
curve_21 = Curve(<curve referenced from the Rhino model>)  # "M0.03"
m0_04a = Curve(<curve referenced from the Rhino model>)
m0_04b = Curve(<curve referenced from the Rhino model>)
curve_22 = Curve(<curve referenced from the Rhino model>)  # "M0.05"
curve_23 = Curve(<curve referenced from the Rhino model>)  # "M0.06"
number_slider_20 = Slider(20, range=0..100)
number_slider_21 = Slider(20, range=0..100)
number_slider_22 = Slider(20, range=0..100)
number_slider_23 = Slider(20, range=0..100)
number_slider_24 = Slider(20, range=0..100)
number_slider_25 = Slider(20, range=0..100)
number_slider_26 = Slider(20, range=0..100)
number_slider_27 = Slider(20, range=0..100)
boundary_surfaces_20 = BoundarySurfaces(Edges=curve_20)
boundary_surfaces_21 = BoundarySurfaces(Edges=m0_02a)
boundary_surfaces_22 = BoundarySurfaces(Edges=m0_02b)
boundary_surfaces_23 = BoundarySurfaces(Edges=curve_21)
boundary_surfaces_24 = BoundarySurfaces(Edges=m0_04a)
boundary_surfaces_25 = BoundarySurfaces(Edges=m0_04b)
boundary_surfaces_26 = BoundarySurfaces(Edges=curve_22)
boundary_surfaces_27 = BoundarySurfaces(Edges=curve_23)
mesh_surface_20 = MeshSurface(Surface=boundary_surfaces_20, UCount=number_slider_20, VCount=number_slider_20, Overhang=True, Equalize=False)
mesh_surface_21 = MeshSurface(Surface=boundary_surfaces_21, UCount=number_slider_21, VCount=number_slider_21, Overhang=True, Equalize=False)
mesh_surface_22 = MeshSurface(Surface=boundary_surfaces_22, UCount=number_slider_22, VCount=number_slider_22, Overhang=True, Equalize=False)
mesh_surface_23 = MeshSurface(Surface=boundary_surfaces_23, UCount=number_slider_23, VCount=number_slider_23, Overhang=True, Equalize=False)
mesh_surface_24 = MeshSurface(Surface=boundary_surfaces_24, UCount=number_slider_24, VCount=number_slider_24, Overhang=True, Equalize=False)
mesh_surface_25 = MeshSurface(Surface=boundary_surfaces_25, UCount=number_slider_25, VCount=number_slider_25, Overhang=True, Equalize=False)
mesh_surface_26 = MeshSurface(Surface=boundary_surfaces_26, UCount=number_slider_26, VCount=number_slider_26, Overhang=True, Equalize=False)
mesh_surface_27 = MeshSurface(Surface=boundary_surfaces_27, UCount=number_slider_27, VCount=number_slider_27, Overhang=True, Equalize=False)

curve_24 = Curve(<curve referenced from the Rhino model>)  # "M0.07"
curve_25 = Curve(<curve referenced from the Rhino model>)  # "M0.08"
curve_26 = Curve(<curve referenced from the Rhino model>)  # "M0.09"
curve_27 = Curve(<curve referenced from the Rhino model>)  # "M0.10"
curve_28 = Curve(<curve referenced from the Rhino model>)  # "M0.11"
curve_29 = Curve(<curve referenced from the Rhino model>)  # "M0.12"
curve_30 = Curve(<curve referenced from the Rhino model>)  # "M0.13"
curve_31 = Curve(<curve referenced from the Rhino model>)  # "M0.14"
curve_32 = Curve(<curve referenced from the Rhino model>)  # "M0.15"
curve_33 = Curve(<curve referenced from the Rhino model>)  # "M0.16"
curve_34 = Curve(<curve referenced from the Rhino model>)  # "M0.17"
number_slider_28 = Slider(20, range=0..100)
number_slider_29 = Slider(20, range=0..100)
number_slider_30 = Slider(20, range=0..100)
number_slider_31 = Slider(20, range=0..100)
number_slider_32 = Slider(20, range=0..100)
number_slider_33 = Slider(20, range=0..100)
number_slider_34 = Slider(20, range=0..100)
number_slider_35 = Slider(20, range=0..100)
number_slider_36 = Slider(20, range=0..100)
number_slider_37 = Slider(20, range=0..100)
number_slider_38 = Slider(20, range=0..100)
boundary_surfaces_28 = BoundarySurfaces(Edges=curve_24)
boundary_surfaces_29 = BoundarySurfaces(Edges=curve_25)
boundary_surfaces_30 = BoundarySurfaces(Edges=curve_26)
boundary_surfaces_31 = BoundarySurfaces(Edges=curve_27)
boundary_surfaces_32 = BoundarySurfaces(Edges=curve_28)
boundary_surfaces_33 = BoundarySurfaces(Edges=curve_29)
boundary_surfaces_34 = BoundarySurfaces(Edges=curve_30)
boundary_surfaces_35 = BoundarySurfaces(Edges=curve_31)
boundary_surfaces_36 = BoundarySurfaces(Edges=curve_32)
boundary_surfaces_37 = BoundarySurfaces(Edges=curve_33)
boundary_surfaces_38 = BoundarySurfaces(Edges=curve_34)
mesh_surface_28 = MeshSurface(Surface=boundary_surfaces_28, UCount=number_slider_28, VCount=number_slider_28, Overhang=True, Equalize=False)
mesh_surface_29 = MeshSurface(Surface=boundary_surfaces_29, UCount=number_slider_29, VCount=number_slider_29, Overhang=True, Equalize=False)
mesh_surface_30 = MeshSurface(Surface=boundary_surfaces_30, UCount=number_slider_30, VCount=number_slider_30, Overhang=True, Equalize=False)
mesh_surface_31 = MeshSurface(Surface=boundary_surfaces_31, UCount=number_slider_31, VCount=number_slider_31, Overhang=True, Equalize=False)
mesh_surface_32 = MeshSurface(Surface=boundary_surfaces_32, UCount=number_slider_32, VCount=number_slider_32, Overhang=True, Equalize=False)
mesh_surface_33 = MeshSurface(Surface=boundary_surfaces_33, UCount=number_slider_33, VCount=number_slider_33, Overhang=True, Equalize=False)
mesh_surface_34 = MeshSurface(Surface=boundary_surfaces_34, UCount=number_slider_34, VCount=number_slider_34, Overhang=True, Equalize=False)
mesh_surface_35 = MeshSurface(Surface=boundary_surfaces_35, UCount=number_slider_35, VCount=number_slider_35, Overhang=True, Equalize=False)
mesh_surface_36 = MeshSurface(Surface=boundary_surfaces_36, UCount=number_slider_36, VCount=number_slider_36, Overhang=True, Equalize=False)
mesh_surface_37 = MeshSurface(Surface=boundary_surfaces_37, UCount=number_slider_37, VCount=number_slider_37, Overhang=True, Equalize=False)
mesh_surface_38 = MeshSurface(Surface=boundary_surfaces_38, UCount=number_slider_38, VCount=number_slider_38, Overhang=True, Equalize=False)

relay = Relay([createelement_8.ElementS, createelement_7.ElementS, createelement_9.ElementS, createelement_10.ElementS, createelement_11.ElementS, createelement_12.ElementS, createelement_13.ElementS, createelement_14.ElementS, createelement_15.ElementS, createelement.ElementS, createelement_16.ElementS, createelement_17.ElementS, createelement_18.ElementS, createelement_19.ElementS, createelement_2.ElementS, createelement_3.ElementS, createelement_4.ElementS, createelement_5.ElementS, createelement_6.ElementS])

unit_z = UnitZ(Factor=1)
unit_z_2 = UnitZ(Factor=1)
unit_z_3 = UnitZ(Factor=1)
unit_z_4 = UnitZ(Factor=1)
unit_z_5 = UnitZ(Factor=1)
unit_z_6 = UnitZ(Factor=1)
unit_z_7 = UnitZ(Factor=1)
unit_z_8 = UnitZ(Factor=1)
panel_42 = Panel("""0
90
0
90
0""")
panel_43 = Panel("""0
90
0
90
0""")
panel_44 = Panel("""0
90
0
90
0""")
panel_45 = Panel("""0
90
0
90
0""")
panel_46 = Panel("""0
90
0
90
0""")
panel_47 = Panel("""0
90
0
90
0""")
panel_48 = Panel("""0
90
0
90
0""")
panel_49 = Panel("""0
90
0
90
0""")
panel_50 = Panel("""40
40
40
40
40""")
panel_51 = Panel("""40
40
40
40
40""")
panel_52 = Panel("""40
40
40
40
40""")
panel_53 = Panel("""40
40
40
40
40""")
panel_54 = Panel("""40
40
40
40
40""")
panel_55 = Panel("""40
40
40
40
40""")
panel_56 = Panel("""40
40
40
40
40""")
panel_57 = Panel("""40
40
40
40
40""")
createelement_20 = CreateElement(
    Mesh=mesh_surface_20,
    Identifier="M0.01",
    MaterialName="C24",
    LayersThickness=panel_50,
    LayersOrientation=panel_42,
    MainOrientation=unit_z)  # -> ElementS, Info, Center, MainFace
createelement_21 = CreateElement(
    Mesh=mesh_surface_21,
    Identifier="M0.02a",
    MaterialName="C24",
    LayersThickness=panel_51,
    LayersOrientation=panel_43,
    MainOrientation=unit_z_2)  # -> ElementS, Info, Center, MainFace
createelement_22 = CreateElement(
    Mesh=mesh_surface_22,
    Identifier="M0.02b",
    MaterialName="C24",
    LayersThickness=panel_52,
    LayersOrientation=panel_44,
    MainOrientation=unit_z_3)  # -> ElementS, Info, Center, MainFace
createelement_23 = CreateElement(
    Mesh=mesh_surface_23,
    Identifier="M0.03",
    MaterialName="C24",
    LayersThickness=panel_53,
    LayersOrientation=panel_45,
    MainOrientation=unit_z_4)  # -> ElementS, Info, Center, MainFace
createelement_24 = CreateElement(
    Mesh=mesh_surface_24,
    Identifier="M0.04a",
    MaterialName="C24",
    LayersThickness=panel_54,
    LayersOrientation=panel_46,
    MainOrientation=unit_z_5)  # -> ElementS, Info, Center, MainFace
createelement_25 = CreateElement(
    Mesh=mesh_surface_25,
    Identifier="M0.04b",
    MaterialName="C24",
    LayersThickness=panel_55,
    LayersOrientation=panel_47,
    MainOrientation=unit_z_6)  # -> ElementS, Info, Center, MainFace
createelement_26 = CreateElement(
    Mesh=mesh_surface_26,
    Identifier="M0.05",
    MaterialName="C24",
    LayersThickness=panel_56,
    LayersOrientation=panel_48,
    MainOrientation=unit_z_7)  # -> ElementS, Info, Center, MainFace
createelement_27 = CreateElement(
    Mesh=mesh_surface_27,
    Identifier="M0.06",
    MaterialName="C24",
    LayersThickness=panel_57,
    LayersOrientation=panel_49,
    MainOrientation=unit_z_8)  # -> ElementS, Info, Center, MainFace

unit_z_9 = UnitZ(Factor=1)
unit_z_10 = UnitZ(Factor=1)
unit_z_11 = UnitZ(Factor=1)
unit_z_12 = UnitZ(Factor=1)
unit_z_13 = UnitZ(Factor=1)
unit_z_14 = UnitZ(Factor=1)
unit_z_15 = UnitZ(Factor=1)
unit_z_16 = UnitZ(Factor=1)
unit_z_17 = UnitZ(Factor=1)
unit_z_18 = UnitZ(Factor=1)
unit_z_19 = UnitZ(Factor=1)
panel_58 = Panel("""0
90
0
90
0""")
panel_59 = Panel("""0
90
0
90
0""")
panel_60 = Panel("""0
90
0
90
0""")
panel_61 = Panel("""0
90
0
90
0""")
panel_62 = Panel("""0
90
0
90
0""")
panel_63 = Panel("""0
90
0
90
0""")
panel_64 = Panel("""0
90
0
90
0""")
panel_65 = Panel("""0
90
0
90
0""")
panel_66 = Panel("""0
90
0
90
0""")
panel_67 = Panel("""0
90
0
90
0""")
panel_68 = Panel("""0
90
0
90
0""")
panel_69 = Panel("""40
40
40
40
40""")
panel_70 = Panel("""40
40
40
40
40""")
panel_71 = Panel("""40
40
40
40
40""")
panel_72 = Panel("""40
40
40
40
40""")
panel_73 = Panel("""40
40
40
40
40""")
panel_74 = Panel("""40
40
40
40
40""")
panel_75 = Panel("""40
40
40
40
40""")
panel_76 = Panel("""40
40
40
40
40""")
panel_77 = Panel("""40
40
40
40
40""")
panel_78 = Panel("""40
40
40
40
40""")
panel_79 = Panel("""40
40
40
40
40""")
createelement_28 = CreateElement(
    Mesh=mesh_surface_28,
    Identifier="M0.07",
    MaterialName="C24",
    LayersThickness=panel_69,
    LayersOrientation=panel_58,
    MainOrientation=unit_z_9)  # -> ElementS, Info, Center, MainFace
createelement_29 = CreateElement(
    Mesh=mesh_surface_29,
    Identifier="M0.08",
    MaterialName="C24",
    LayersThickness=panel_70,
    LayersOrientation=panel_59,
    MainOrientation=unit_z_10)  # -> ElementS, Info, Center, MainFace
createelement_30 = CreateElement(
    Mesh=mesh_surface_30,
    Identifier="M0.09",
    MaterialName="C24",
    LayersThickness=panel_71,
    LayersOrientation=panel_60,
    MainOrientation=unit_z_11)  # -> ElementS, Info, Center, MainFace
createelement_31 = CreateElement(
    Mesh=mesh_surface_31,
    Identifier="M0.10",
    MaterialName="C24",
    LayersThickness=panel_72,
    LayersOrientation=panel_61,
    MainOrientation=unit_z_12)  # -> ElementS, Info, Center, MainFace
createelement_32 = CreateElement(
    Mesh=mesh_surface_32,
    Identifier="M0.11",
    MaterialName="C24",
    LayersThickness=panel_73,
    LayersOrientation=panel_62,
    MainOrientation=unit_z_13)  # -> ElementS, Info, Center, MainFace
createelement_33 = CreateElement(
    Mesh=mesh_surface_33,
    Identifier="M0.12",
    MaterialName="C24",
    LayersThickness=panel_74,
    LayersOrientation=panel_63,
    MainOrientation=unit_z_14)  # -> ElementS, Info, Center, MainFace
createelement_34 = CreateElement(
    Mesh=mesh_surface_34,
    Identifier="M0.13",
    MaterialName="C24",
    LayersThickness=panel_75,
    LayersOrientation=panel_64,
    MainOrientation=unit_z_15)  # -> ElementS, Info, Center, MainFace
createelement_35 = CreateElement(
    Mesh=mesh_surface_35,
    Identifier="M0.14",
    MaterialName="C24",
    LayersThickness=panel_76,
    LayersOrientation=panel_65,
    MainOrientation=unit_z_16)  # -> ElementS, Info, Center, MainFace
createelement_36 = CreateElement(
    Mesh=mesh_surface_36,
    Identifier="M0.15",
    MaterialName="C24",
    LayersThickness=panel_77,
    LayersOrientation=panel_66,
    MainOrientation=unit_z_17)  # -> ElementS, Info, Center, MainFace
createelement_37 = CreateElement(
    Mesh=mesh_surface_37,
    Identifier="M0.16",
    MaterialName="C24",
    LayersThickness=panel_78,
    LayersOrientation=panel_67,
    MainOrientation=unit_z_18)  # -> ElementS, Info, Center, MainFace
createelement_38 = CreateElement(
    Mesh=mesh_surface_38,
    Identifier="M0.17",
    MaterialName="C24",
    LayersThickness=panel_79,
    LayersOrientation=panel_68,
    MainOrientation=unit_z_19)  # -> ElementS, Info, Center, MainFace

relay_2 = Relay([createelement_27.ElementS, createelement_26.ElementS, createelement_25.ElementS, createelement_24.ElementS, createelement_23.ElementS, createelement_22.ElementS, createelement_21.ElementS, createelement_20.ElementS])
relay_3 = Relay([createelement_28.ElementS, createelement_29.ElementS, createelement_30.ElementS, createelement_31.ElementS, createelement_32.ElementS, createelement_33.ElementS, createelement_34.ElementS, createelement_35.ElementS, createelement_36.ElementS, createelement_37.ElementS, createelement_38.ElementS])
relay_4 = Relay([relay, relay_2, relay_3])

curve_35 = Curve(<curve referenced from the Rhino model>)  # "T1.04"
curve_36 = Curve(<curve referenced from the Rhino model>)  # "T1.06"
curve_37 = Curve(<curve referenced from the Rhino model>)  # "T1.07"
curve_38 = Curve(<curve referenced from the Rhino model>)  # "T1.08"
curve_39 = Curve(<curve referenced from the Rhino model>)  # "T1.09"
curve_40 = Curve(<curve referenced from the Rhino model>)  # "T1.10"
curve_41 = Curve(<curve referenced from the Rhino model>)  # "T1.01"
curve_42 = Curve(<curve referenced from the Rhino model>)  # "T1.02"
curve_43 = Curve(<curve referenced from the Rhino model>)  # "T1.03"
curve_44 = Curve(<curve referenced from the Rhino model>)  # "T1.05"
number_slider_39 = Slider(20, range=0..100)
number_slider_40 = Slider(20, range=0..100)
number_slider_41 = Slider(20, range=0..100)
number_slider_42 = Slider(20, range=0..100)
number_slider_43 = Slider(20, range=0..100)
number_slider_44 = Slider(20, range=0..100)
number_slider_45 = Slider(20, range=0..100)
number_slider_46 = Slider(20, range=0..100)
number_slider_47 = Slider(20, range=0..100)
number_slider_48 = Slider(20, range=0..100)
boundary_surfaces_39 = BoundarySurfaces(Edges=curve_41)
boundary_surfaces_40 = BoundarySurfaces(Edges=curve_42)
boundary_surfaces_41 = BoundarySurfaces(Edges=curve_43)
boundary_surfaces_42 = BoundarySurfaces(Edges=curve_35)
boundary_surfaces_43 = BoundarySurfaces(Edges=curve_44)
boundary_surfaces_44 = BoundarySurfaces(Edges=curve_36)
boundary_surfaces_45 = BoundarySurfaces(Edges=curve_37)
boundary_surfaces_46 = BoundarySurfaces(Edges=curve_38)
boundary_surfaces_47 = BoundarySurfaces(Edges=curve_39)
boundary_surfaces_48 = BoundarySurfaces(Edges=curve_40)
mesh_surface_39 = MeshSurface(Surface=boundary_surfaces_39, UCount=number_slider_39, VCount=number_slider_39, Overhang=True, Equalize=False)
mesh_surface_40 = MeshSurface(Surface=boundary_surfaces_40, UCount=number_slider_40, VCount=number_slider_40, Overhang=True, Equalize=False)
mesh_surface_41 = MeshSurface(Surface=boundary_surfaces_41, UCount=number_slider_41, VCount=number_slider_41, Overhang=True, Equalize=False)
mesh_surface_42 = MeshSurface(Surface=boundary_surfaces_42, UCount=number_slider_42, VCount=number_slider_42, Overhang=True, Equalize=False)
mesh_surface_43 = MeshSurface(Surface=boundary_surfaces_43, UCount=number_slider_43, VCount=number_slider_43, Overhang=True, Equalize=False)
mesh_surface_44 = MeshSurface(Surface=boundary_surfaces_44, UCount=number_slider_44, VCount=number_slider_44, Overhang=True, Equalize=False)
mesh_surface_45 = MeshSurface(Surface=boundary_surfaces_45, UCount=number_slider_45, VCount=number_slider_45, Overhang=True, Equalize=False)
mesh_surface_46 = MeshSurface(Surface=boundary_surfaces_46, UCount=number_slider_46, VCount=number_slider_46, Overhang=True, Equalize=False)
mesh_surface_47 = MeshSurface(Surface=boundary_surfaces_47, UCount=number_slider_47, VCount=number_slider_47, Overhang=True, Equalize=False)
mesh_surface_48 = MeshSurface(Surface=boundary_surfaces_48, UCount=number_slider_48, VCount=number_slider_48, Overhang=True, Equalize=False)

curve_45 = Curve(<curve referenced from the Rhino model>)  # "M1.04"
curve_46 = Curve(<curve referenced from the Rhino model>)  # "M1.05"
curve_47 = Curve(<curve referenced from the Rhino model>)  # "M1.06"
curve_48 = Curve(<curve referenced from the Rhino model>)  # "M1.07"
curve_49 = Curve(<curve referenced from the Rhino model>)  # "M1.08"
number_slider_49 = Slider(20, range=0..100)
number_slider_50 = Slider(20, range=0..100)
number_slider_51 = Slider(20, range=0..100)
number_slider_52 = Slider(20, range=0..100)
number_slider_53 = Slider(20, range=0..100)
boundary_surfaces_49 = BoundarySurfaces(Edges=curve_45)
boundary_surfaces_50 = BoundarySurfaces(Edges=curve_46)
boundary_surfaces_51 = BoundarySurfaces(Edges=curve_47)
boundary_surfaces_52 = BoundarySurfaces(Edges=curve_48)
boundary_surfaces_53 = BoundarySurfaces(Edges=curve_49)
mesh_surface_49 = MeshSurface(Surface=boundary_surfaces_49, UCount=number_slider_49, VCount=number_slider_49, Overhang=True, Equalize=False)
mesh_surface_50 = MeshSurface(Surface=boundary_surfaces_50, UCount=number_slider_50, VCount=number_slider_50, Overhang=True, Equalize=False)
mesh_surface_51 = MeshSurface(Surface=boundary_surfaces_51, UCount=number_slider_51, VCount=number_slider_51, Overhang=True, Equalize=False)
mesh_surface_52 = MeshSurface(Surface=boundary_surfaces_52, UCount=number_slider_52, VCount=number_slider_52, Overhang=True, Equalize=False)
mesh_surface_53 = MeshSurface(Surface=boundary_surfaces_53, UCount=number_slider_53, VCount=number_slider_53, Overhang=True, Equalize=False)

curve_50 = Curve(<curve referenced from the Rhino model>)  # "M1.01"
curve_51 = Curve(<curve referenced from the Rhino model>)  # "M1.02"
curve_52 = Curve(<curve referenced from the Rhino model>)  # "M1.03"
number_slider_54 = Slider(20, range=0..100)
number_slider_55 = Slider(20, range=0..100)
number_slider_56 = Slider(20, range=0..100)
boundary_surfaces_54 = BoundarySurfaces(Edges=curve_50)
boundary_surfaces_55 = BoundarySurfaces(Edges=curve_51)
boundary_surfaces_56 = BoundarySurfaces(Edges=curve_52)
mesh_surface_54 = MeshSurface(Surface=boundary_surfaces_54, UCount=number_slider_54, VCount=number_slider_54, Overhang=True, Equalize=False)
mesh_surface_55 = MeshSurface(Surface=boundary_surfaces_55, UCount=number_slider_55, VCount=number_slider_55, Overhang=True, Equalize=False)
mesh_surface_56 = MeshSurface(Surface=boundary_surfaces_56, UCount=number_slider_56, VCount=number_slider_56, Overhang=True, Equalize=False)

unit_y_20 = UnitY(Factor=1)
unit_y_21 = UnitY(Factor=1)
unit_y_22 = UnitY(Factor=1)
unit_y_23 = UnitY(Factor=1)
unit_y_24 = UnitY(Factor=1)
unit_y_25 = UnitY(Factor=1)
unit_y_26 = UnitY(Factor=1)
unit_y_27 = UnitY(Factor=1)
unit_y_28 = UnitY(Factor=1)
unit_y_29 = UnitY(Factor=1)
panel_80 = Panel("""0
90
0
90
0""")
panel_81 = Panel("""0
90
0
90
0""")
panel_82 = Panel("""0
90
0
90
0""")
panel_83 = Panel("""0
90
0
90
0""")
panel_84 = Panel("""0
90
0
90
0""")
panel_85 = Panel("""0
90
0
90
0""")
panel_86 = Panel("""0
90
0
90
0""")
panel_87 = Panel("""0
90
0
90
0""")
panel_88 = Panel("""0
90
0
90
0""")
panel_89 = Panel("""0
90
0
90
0""")
panel_90 = Panel("""40
40
40
40
40""")
panel_91 = Panel("""40
40
40
40
40""")
panel_92 = Panel("""40
40
40
40
40""")
panel_93 = Panel("""40
40
40
40
40""")
panel_94 = Panel("""40
40
40
40
40""")
panel_95 = Panel("""40
40
40
40
40""")
panel_96 = Panel("""40
40
40
40
40""")
panel_97 = Panel("""40
40
40
40
40""")
panel_98 = Panel("""40
40
40
40
40""")
panel_99 = Panel("""40
40
40
40
40""")
createelement_39 = CreateElement(
    Mesh=mesh_surface_39,
    Identifier="T1.01",
    MaterialName="C24",
    LayersThickness=panel_90,
    LayersOrientation=panel_80,
    MainOrientation=unit_y_20)  # -> ElementS, Info, Center, MainFace
createelement_40 = CreateElement(
    Mesh=mesh_surface_40,
    Identifier="T1.02",
    MaterialName="C24",
    LayersThickness=panel_91,
    LayersOrientation=panel_81,
    MainOrientation=unit_y_21)  # -> ElementS, Info, Center, MainFace
createelement_41 = CreateElement(
    Mesh=mesh_surface_41,
    Identifier="T1.03",
    MaterialName="C24",
    LayersThickness=panel_92,
    LayersOrientation=panel_82,
    MainOrientation=unit_y_22)  # -> ElementS, Info, Center, MainFace
createelement_42 = CreateElement(
    Mesh=mesh_surface_42,
    Identifier="T1.04",
    MaterialName="C24",
    LayersThickness=panel_93,
    LayersOrientation=panel_83,
    MainOrientation=unit_y_23)  # -> ElementS, Info, Center, MainFace
createelement_43 = CreateElement(
    Mesh=mesh_surface_43,
    Identifier="T1.05",
    MaterialName="C24",
    LayersThickness=panel_94,
    LayersOrientation=panel_84,
    MainOrientation=unit_y_24)  # -> ElementS, Info, Center, MainFace
createelement_44 = CreateElement(
    Mesh=mesh_surface_44,
    Identifier="T1.06",
    MaterialName="C24",
    LayersThickness=panel_95,
    LayersOrientation=panel_85,
    MainOrientation=unit_y_25)  # -> ElementS, Info, Center, MainFace
createelement_45 = CreateElement(
    Mesh=mesh_surface_45,
    Identifier="T1.07",
    MaterialName="C24",
    LayersThickness=panel_96,
    LayersOrientation=panel_86,
    MainOrientation=unit_y_26)  # -> ElementS, Info, Center, MainFace
createelement_46 = CreateElement(
    Mesh=mesh_surface_46,
    Identifier="T1.08",
    MaterialName="C24",
    LayersThickness=panel_97,
    LayersOrientation=panel_87,
    MainOrientation=unit_y_27)  # -> ElementS, Info, Center, MainFace
createelement_47 = CreateElement(
    Mesh=mesh_surface_47,
    Identifier="T1.09",
    MaterialName="C24",
    LayersThickness=panel_98,
    LayersOrientation=panel_88,
    MainOrientation=unit_y_28)  # -> ElementS, Info, Center, MainFace
createelement_48 = CreateElement(
    Mesh=mesh_surface_48,
    Identifier="T1.10",
    MaterialName="C24",
    LayersThickness=panel_99,
    LayersOrientation=panel_89,
    MainOrientation=unit_y_29)  # -> ElementS, Info, Center, MainFace

unit_z_20 = UnitZ(Factor=1)
unit_z_21 = UnitZ(Factor=1)
unit_z_22 = UnitZ(Factor=1)
unit_z_23 = UnitZ(Factor=1)
unit_z_24 = UnitZ(Factor=1)
panel_100 = Panel("""0
90
0
90
0""")
panel_101 = Panel("""0
90
0
90
0""")
panel_102 = Panel("""0
90
0
90
0""")
panel_103 = Panel("""0
90
0
90
0""")
panel_104 = Panel("""0
90
0
90
0""")
panel_105 = Panel("""40
40
40
40
40""")
panel_106 = Panel("""40
40
40
40
40""")
panel_107 = Panel("""40
40
40
40
40""")
panel_108 = Panel("""40
40
40
40
40""")
panel_109 = Panel("""40
40
40
40
40""")
createelement_49 = CreateElement(
    Mesh=mesh_surface_49,
    Identifier="M1.04",
    MaterialName="C24",
    LayersThickness=panel_105,
    LayersOrientation=panel_100,
    MainOrientation=unit_z_20)  # -> ElementS, Info, Center, MainFace
createelement_50 = CreateElement(
    Mesh=mesh_surface_50,
    Identifier="M1.05",
    MaterialName="C24",
    LayersThickness=panel_106,
    LayersOrientation=panel_101,
    MainOrientation=unit_z_21)  # -> ElementS, Info, Center, MainFace
createelement_51 = CreateElement(
    Mesh=mesh_surface_51,
    Identifier="M1.06",
    MaterialName="C24",
    LayersThickness=panel_107,
    LayersOrientation=panel_102,
    MainOrientation=unit_z_22)  # -> ElementS, Info, Center, MainFace
createelement_52 = CreateElement(
    Mesh=mesh_surface_52,
    Identifier="M1.07",
    MaterialName="C24",
    LayersThickness=panel_108,
    LayersOrientation=panel_103,
    MainOrientation=unit_z_23)  # -> ElementS, Info, Center, MainFace
createelement_53 = CreateElement(
    Mesh=mesh_surface_53,
    Identifier="M1.08",
    MaterialName="C24",
    LayersThickness=panel_109,
    LayersOrientation=panel_104,
    MainOrientation=unit_z_24)  # -> ElementS, Info, Center, MainFace

unit_z_25 = UnitZ(Factor=1)
unit_z_26 = UnitZ(Factor=1)
unit_z_27 = UnitZ(Factor=1)
panel_110 = Panel("""0
90
0
90
0""")
panel_111 = Panel("""0
90
0
90
0""")
panel_112 = Panel("""0
90
0
90
0""")
panel_113 = Panel("""40
40
40
40
40""")
panel_114 = Panel("""40
40
40
40
40""")
panel_115 = Panel("""40
40
40
40
40""")
createelement_54 = CreateElement(
    Mesh=mesh_surface_54,
    Identifier="M1.01",
    MaterialName="C24",
    LayersThickness=panel_113,
    LayersOrientation=panel_110,
    MainOrientation=unit_z_25)  # -> ElementS, Info, Center, MainFace
createelement_55 = CreateElement(
    Mesh=mesh_surface_55,
    Identifier="M1.02",
    MaterialName="C24",
    LayersThickness=panel_114,
    LayersOrientation=panel_111,
    MainOrientation=unit_z_26)  # -> ElementS, Info, Center, MainFace
createelement_56 = CreateElement(
    Mesh=mesh_surface_56,
    Identifier="M1.03",
    MaterialName="C24",
    LayersThickness=panel_115,
    LayersOrientation=panel_112,
    MainOrientation=unit_z_27)  # -> ElementS, Info, Center, MainFace

relay_5 = Relay([createelement_39.ElementS, createelement_40.ElementS, createelement_41.ElementS, createelement_42.ElementS, createelement_43.ElementS, createelement_44.ElementS, createelement_45.ElementS, createelement_46.ElementS, createelement_47.ElementS, createelement_48.ElementS])
relay_6 = Relay([createelement_49.ElementS, createelement_50.ElementS, createelement_51.ElementS, createelement_52.ElementS, createelement_53.ElementS])
relay_7 = Relay([createelement_54.ElementS, createelement_56.ElementS, createelement_55.ElementS])

curve_53 = Curve(<curve referenced from the Rhino model>)  # "M0.07"
curve_54 = Curve(<curve referenced from the Rhino model>)  # "M0.08"
curve_55 = Curve(<curve referenced from the Rhino model>)  # "M0.09"
curve_56 = Curve(<curve referenced from the Rhino model>)  # "M0.10"
curve_57 = Curve(<curve referenced from the Rhino model>)  # "M0.11"
curve_58 = Curve(<curve referenced from the Rhino model>)  # "M0.12"
curve_59 = Curve(<curve referenced from the Rhino model>)  # "M0.13"
curve_60 = Curve(<curve referenced from the Rhino model>)  # "M0.14"
curve_61 = Curve(<curve referenced from the Rhino model>)  # "M0.15"
curve_62 = Curve(<curve referenced from the Rhino model>)  # "M0.16"
curve_63 = Curve(<curve referenced from the Rhino model>)  # "M0.17"
boundary_surfaces_57 = BoundarySurfaces(Edges=curve_57)
boundary_surfaces_58 = BoundarySurfaces(Edges=curve_58)
boundary_surfaces_59 = BoundarySurfaces(Edges=curve_60)
boundary_surfaces_60 = BoundarySurfaces(Edges=curve_61)
boundary_surfaces_61 = BoundarySurfaces(Edges=curve_53)
boundary_surfaces_62 = BoundarySurfaces(Edges=curve_54)
boundary_surfaces_63 = BoundarySurfaces(Edges=curve_55)
boundary_surfaces_64 = BoundarySurfaces(Edges=curve_56)
boundary_surfaces_65 = BoundarySurfaces(Edges=curve_59)
boundary_surfaces_66 = BoundarySurfaces(Edges=curve_62)
boundary_surfaces_67 = BoundarySurfaces(Edges=curve_63)
number_slider_57 = Slider(20, range=0..100)
number_slider_58 = Slider(20, range=0..100)
number_slider_59 = Slider(20, range=0..100)
number_slider_60 = Slider(20, range=0..100)
number_slider_61 = Slider(20, range=0..100)
number_slider_62 = Slider(20, range=0..100)
number_slider_63 = Slider(20, range=0..100)
number_slider_64 = Slider(20, range=0..100)
number_slider_65 = Slider(20, range=0..100)
number_slider_66 = Slider(20, range=0..100)
number_slider_67 = Slider(20, range=0..100)
mesh_surface_57 = MeshSurface(Surface=boundary_surfaces_61, UCount=number_slider_57, VCount=number_slider_57, Overhang=True, Equalize=False)
mesh_surface_58 = MeshSurface(Surface=boundary_surfaces_62, UCount=number_slider_58, VCount=number_slider_58, Overhang=True, Equalize=False)
mesh_surface_59 = MeshSurface(Surface=boundary_surfaces_63, UCount=number_slider_62, VCount=number_slider_62, Overhang=True, Equalize=False)
mesh_surface_60 = MeshSurface(Surface=boundary_surfaces_64, UCount=number_slider_63, VCount=number_slider_63, Overhang=True, Equalize=False)
mesh_surface_61 = MeshSurface(Surface=boundary_surfaces_57, UCount=number_slider_64, VCount=number_slider_64, Overhang=True, Equalize=False)
mesh_surface_62 = MeshSurface(Surface=boundary_surfaces_58, UCount=number_slider_65, VCount=number_slider_65, Overhang=True, Equalize=False)
mesh_surface_63 = MeshSurface(Surface=boundary_surfaces_65, UCount=number_slider_66, VCount=number_slider_66, Overhang=True, Equalize=False)
mesh_surface_64 = MeshSurface(Surface=boundary_surfaces_59, UCount=number_slider_59, VCount=number_slider_59, Overhang=True, Equalize=False)
mesh_surface_65 = MeshSurface(Surface=boundary_surfaces_60, UCount=number_slider_60, VCount=number_slider_60, Overhang=True, Equalize=False)
mesh_surface_66 = MeshSurface(Surface=boundary_surfaces_66, UCount=number_slider_67, VCount=number_slider_67, Overhang=True, Equalize=False)
mesh_surface_67 = MeshSurface(Surface=boundary_surfaces_67, UCount=number_slider_61, VCount=number_slider_61, Overhang=True, Equalize=False)

relay_8 = Relay([relay_5, relay_4, relay_6, relay_7])

deconstruct_mesh = DeconstructMesh(Mesh=flatten(mesh_surface_57))  # -> Vertices, Faces, Colours, Normals
deconstruct_mesh_2 = DeconstructMesh(Mesh=flatten(mesh_surface_58))  # -> Vertices, Faces, Colours, Normals
deconstruct_mesh_3 = DeconstructMesh(Mesh=flatten(mesh_surface_59))  # -> Vertices, Faces, Colours, Normals
deconstruct_mesh_4 = DeconstructMesh(Mesh=flatten(mesh_surface_60))  # -> Vertices, Faces, Colours, Normals
deconstruct_mesh_5 = DeconstructMesh(Mesh=flatten(mesh_surface_61))  # -> Vertices, Faces, Colours, Normals
deconstruct_mesh_6 = DeconstructMesh(Mesh=flatten(mesh_surface_62))  # -> Vertices, Faces, Colours, Normals
deconstruct_mesh_7 = DeconstructMesh(Mesh=flatten(mesh_surface_63))  # -> Vertices, Faces, Colours, Normals
deconstruct_mesh_8 = DeconstructMesh(Mesh=flatten(mesh_surface_64))  # -> Vertices, Faces, Colours, Normals
deconstruct_mesh_9 = DeconstructMesh(Mesh=flatten(mesh_surface_65))  # -> Vertices, Faces, Colours, Normals
deconstruct_mesh_10 = DeconstructMesh(Mesh=flatten(mesh_surface_66))  # -> Vertices, Faces, Colours, Normals
deconstruct_mesh_11 = DeconstructMesh(Mesh=flatten(mesh_surface_67))  # -> Vertices, Faces, Colours, Normals
deconstruct = Deconstruct(Point=deconstruct_mesh.Vertices)  # -> XComponent, YComponent, ZComponent
deconstruct_2 = Deconstruct(Point=deconstruct_mesh_2.Vertices)  # -> XComponent, YComponent, ZComponent
deconstruct_3 = Deconstruct(Point=deconstruct_mesh_3.Vertices)  # -> XComponent, YComponent, ZComponent
deconstruct_4 = Deconstruct(Point=deconstruct_mesh_4.Vertices)  # -> XComponent, YComponent, ZComponent
deconstruct_5 = Deconstruct(Point=deconstruct_mesh_5.Vertices)  # -> XComponent, YComponent, ZComponent
deconstruct_6 = Deconstruct(Point=deconstruct_mesh_6.Vertices)  # -> XComponent, YComponent, ZComponent
deconstruct_7 = Deconstruct(Point=deconstruct_mesh_7.Vertices)  # -> XComponent, YComponent, ZComponent
deconstruct_8 = Deconstruct(Point=deconstruct_mesh_8.Vertices)  # -> XComponent, YComponent, ZComponent
deconstruct_9 = Deconstruct(Point=deconstruct_mesh_9.Vertices)  # -> XComponent, YComponent, ZComponent
deconstruct_10 = Deconstruct(Point=deconstruct_mesh_10.Vertices)  # -> XComponent, YComponent, ZComponent
deconstruct_11 = Deconstruct(Point=deconstruct_mesh_11.Vertices)  # -> XComponent, YComponent, ZComponent
similarity = Similarity(FirstNumber=deconstruct.ZComponent, SecondNumber="0", Threshold=0.1)  # -> Similarity, AbsoluteDifference
similarity_2 = Similarity(FirstNumber=deconstruct_2.ZComponent, SecondNumber="0", Threshold=0.1)  # -> Similarity, AbsoluteDifference
similarity_3 = Similarity(FirstNumber=deconstruct_3.ZComponent, SecondNumber="0", Threshold=0.1)  # -> Similarity, AbsoluteDifference
similarity_4 = Similarity(FirstNumber=deconstruct_4.ZComponent, SecondNumber="0", Threshold=0.1)  # -> Similarity, AbsoluteDifference
similarity_5 = Similarity(FirstNumber=deconstruct_5.ZComponent, SecondNumber="0", Threshold=0.1)  # -> Similarity, AbsoluteDifference
similarity_6 = Similarity(FirstNumber=deconstruct_6.ZComponent, SecondNumber="0", Threshold=0.1)  # -> Similarity, AbsoluteDifference
similarity_7 = Similarity(FirstNumber=deconstruct_7.ZComponent, SecondNumber="0", Threshold=0.1)  # -> Similarity, AbsoluteDifference
similarity_8 = Similarity(FirstNumber=deconstruct_8.ZComponent, SecondNumber="0", Threshold=0.1)  # -> Similarity, AbsoluteDifference
similarity_9 = Similarity(FirstNumber=deconstruct_9.ZComponent, SecondNumber="0", Threshold=0.1)  # -> Similarity, AbsoluteDifference
similarity_10 = Similarity(FirstNumber=deconstruct_10.ZComponent, SecondNumber="0", Threshold=0.1)  # -> Similarity, AbsoluteDifference
similarity_11 = Similarity(FirstNumber=deconstruct_11.ZComponent, SecondNumber="0", Threshold=0.1)  # -> Similarity, AbsoluteDifference
cull_pattern = CullPattern(List=deconstruct_mesh.Vertices, CullPattern=similarity.Similarity)
cull_pattern_2 = CullPattern(List=deconstruct_mesh_2.Vertices, CullPattern=similarity_2.Similarity)
cull_pattern_3 = CullPattern(List=deconstruct_mesh_3.Vertices, CullPattern=similarity_3.Similarity)
cull_pattern_4 = CullPattern(List=deconstruct_mesh_4.Vertices, CullPattern=similarity_4.Similarity)
cull_pattern_5 = CullPattern(List=deconstruct_mesh_5.Vertices, CullPattern=similarity_5.Similarity)
cull_pattern_6 = CullPattern(List=deconstruct_mesh_6.Vertices, CullPattern=similarity_6.Similarity)
cull_pattern_7 = CullPattern(List=deconstruct_mesh_7.Vertices, CullPattern=similarity_7.Similarity)
cull_pattern_8 = CullPattern(List=deconstruct_mesh_8.Vertices, CullPattern=similarity_8.Similarity)
cull_pattern_9 = CullPattern(List=deconstruct_mesh_9.Vertices, CullPattern=similarity_9.Similarity)
cull_pattern_10 = CullPattern(List=deconstruct_mesh_10.Vertices, CullPattern=similarity_10.Similarity)
cull_pattern_11 = CullPattern(List=deconstruct_mesh_11.Vertices, CullPattern=similarity_11.Similarity)
support = Support(Points=cull_pattern, Plane=PlaneXY(0, 0, 0), Ct=0, Cr=0, Rx=False, Ry=True, Rz=True, Tx=True, Ty=True, Tz=True)
support_2 = Support(Points=cull_pattern_2, Plane=PlaneXY(0, 0, 0), Ct=0, Cr=0, Rx=False, Ry=True, Rz=True, Tx=True, Ty=True, Tz=True)
support_3 = Support(Points=cull_pattern_3, Plane=PlaneXY(0, 0, 0), Ct=0, Cr=0, Rx=False, Ry=True, Rz=True, Tx=True, Ty=True, Tz=True)
support_4 = Support(Points=cull_pattern_4, Plane=PlaneXY(0, 0, 0), Ct=0, Cr=0, Rx=False, Ry=True, Rz=True, Tx=True, Ty=True, Tz=True)
support_5 = Support(Points=cull_pattern_5, Plane=PlaneXY(0, 0, 0), Ct=0, Cr=0, Rx=False, Ry=True, Rz=True, Tx=True, Ty=True, Tz=True)
support_6 = Support(Points=cull_pattern_6, Plane=PlaneXY(0, 0, 0), Ct=0, Cr=0, Rx=False, Ry=True, Rz=True, Tx=True, Ty=True, Tz=True)
support_7 = Support(Points=cull_pattern_7, Plane=PlaneXY(0, 0, 0), Ct=0, Cr=0, Rx=False, Ry=True, Rz=True, Tx=True, Ty=True, Tz=True)
support_8 = Support(Points=cull_pattern_8, Plane=PlaneXY(0, 0, 0), Ct=0, Cr=0, Rx=False, Ry=True, Rz=True, Tx=True, Ty=True, Tz=True)
support_9 = Support(Points=cull_pattern_9, Plane=PlaneXY(0, 0, 0), Ct=0, Cr=0, Rx=False, Ry=True, Rz=True, Tx=True, Ty=True, Tz=True)
support_10 = Support(Points=cull_pattern_10, Plane=PlaneXY(0, 0, 0), Ct=0, Cr=0, Rx=False, Ry=True, Rz=True, Tx=True, Ty=True, Tz=True)
support_11 = Support(Points=cull_pattern_11, Plane=PlaneXY(0, 0, 0), Ct=0, Cr=0, Rx=False, Ry=True, Rz=True, Tx=True, Ty=True, Tz=True)

curve_64 = Curve(<curve referenced from the Rhino model>)  # "M0.01"
curve_65 = Curve(<curve referenced from the Rhino model>)  # "M0.02"
curve_66 = Curve(<curve referenced from the Rhino model>)  # "M0.03"
curve_67 = Curve(<curve referenced from the Rhino model>)  # "M0.04"
curve_68 = Curve(<curve referenced from the Rhino model>)  # "M0.05"
curve_69 = Curve(<curve referenced from the Rhino model>)  # "M0.06"
boundary_surfaces_68 = BoundarySurfaces(Edges=curve_64)
boundary_surfaces_69 = BoundarySurfaces(Edges=curve_65)
boundary_surfaces_70 = BoundarySurfaces(Edges=curve_66)
boundary_surfaces_71 = BoundarySurfaces(Edges=curve_67)
boundary_surfaces_72 = BoundarySurfaces(Edges=curve_68)
boundary_surfaces_73 = BoundarySurfaces(Edges=curve_69)
number_slider_68 = Slider(20, range=0..100)
number_slider_69 = Slider(20, range=0..100)
number_slider_70 = Slider(20, range=0..100)
number_slider_71 = Slider(20, range=0..100)
number_slider_72 = Slider(20, range=0..100)
number_slider_73 = Slider(20, range=0..100)
mesh_surface_68 = MeshSurface(Surface=boundary_surfaces_68, UCount=number_slider_68, VCount=number_slider_68, Overhang=True, Equalize=False)
mesh_surface_69 = MeshSurface(Surface=boundary_surfaces_69, UCount=number_slider_69, VCount=number_slider_69, Overhang=True, Equalize=False)
mesh_surface_70 = MeshSurface(Surface=boundary_surfaces_70, UCount=number_slider_70, VCount=number_slider_70, Overhang=True, Equalize=False)
mesh_surface_71 = MeshSurface(Surface=boundary_surfaces_71, UCount=number_slider_71, VCount=number_slider_71, Overhang=True, Equalize=False)
mesh_surface_72 = MeshSurface(Surface=boundary_surfaces_72, UCount=number_slider_72, VCount=number_slider_72, Overhang=True, Equalize=False)
mesh_surface_73 = MeshSurface(Surface=boundary_surfaces_73, UCount=number_slider_73, VCount=number_slider_73, Overhang=True, Equalize=False)

relay_9 = Relay([support_11, support_10, support_9, support_8, support_7, support_6, support_5, support_4, support_3, support, support_2])

deconstruct_mesh_12 = DeconstructMesh(Mesh=flatten(mesh_surface_68))  # -> Vertices, Faces, Colours, Normals
deconstruct_mesh_13 = DeconstructMesh(Mesh=flatten(mesh_surface_69))  # -> Vertices, Faces, Colours, Normals
deconstruct_mesh_14 = DeconstructMesh(Mesh=flatten(mesh_surface_70))  # -> Vertices, Faces, Colours, Normals
deconstruct_mesh_15 = DeconstructMesh(Mesh=flatten(mesh_surface_71))  # -> Vertices, Faces, Colours, Normals
deconstruct_mesh_16 = DeconstructMesh(Mesh=flatten(mesh_surface_72))  # -> Vertices, Faces, Colours, Normals
deconstruct_mesh_17 = DeconstructMesh(Mesh=flatten(mesh_surface_73))  # -> Vertices, Faces, Colours, Normals
deconstruct_12 = Deconstruct(Point=deconstruct_mesh_12.Vertices)  # -> XComponent, YComponent, ZComponent
deconstruct_13 = Deconstruct(Point=deconstruct_mesh_13.Vertices)  # -> XComponent, YComponent, ZComponent
deconstruct_14 = Deconstruct(Point=deconstruct_mesh_14.Vertices)  # -> XComponent, YComponent, ZComponent
deconstruct_15 = Deconstruct(Point=deconstruct_mesh_15.Vertices)  # -> XComponent, YComponent, ZComponent
deconstruct_16 = Deconstruct(Point=deconstruct_mesh_16.Vertices)  # -> XComponent, YComponent, ZComponent
deconstruct_17 = Deconstruct(Point=deconstruct_mesh_17.Vertices)  # -> XComponent, YComponent, ZComponent
similarity_12 = Similarity(FirstNumber=deconstruct_12.ZComponent, SecondNumber="0", Threshold=0.1)  # -> Similarity, AbsoluteDifference
similarity_13 = Similarity(FirstNumber=deconstruct_13.ZComponent, SecondNumber="0", Threshold=0.1)  # -> Similarity, AbsoluteDifference
similarity_14 = Similarity(FirstNumber=deconstruct_14.ZComponent, SecondNumber="0", Threshold=0.1)  # -> Similarity, AbsoluteDifference
similarity_15 = Similarity(FirstNumber=deconstruct_15.ZComponent, SecondNumber="0", Threshold=0.1)  # -> Similarity, AbsoluteDifference
similarity_16 = Similarity(FirstNumber=deconstruct_16.ZComponent, SecondNumber="0", Threshold=0.1)  # -> Similarity, AbsoluteDifference
similarity_17 = Similarity(FirstNumber=deconstruct_17.ZComponent, SecondNumber="0", Threshold=0.1)  # -> Similarity, AbsoluteDifference
cull_pattern_12 = CullPattern(List=deconstruct_mesh_12.Vertices, CullPattern=similarity_12.Similarity)
cull_pattern_13 = CullPattern(List=deconstruct_mesh_13.Vertices, CullPattern=similarity_13.Similarity)
cull_pattern_14 = CullPattern(List=deconstruct_mesh_14.Vertices, CullPattern=similarity_14.Similarity)
cull_pattern_15 = CullPattern(List=deconstruct_mesh_15.Vertices, CullPattern=similarity_15.Similarity)
cull_pattern_16 = CullPattern(List=deconstruct_mesh_16.Vertices, CullPattern=similarity_16.Similarity)
cull_pattern_17 = CullPattern(List=deconstruct_mesh_17.Vertices, CullPattern=similarity_17.Similarity)
support_12 = Support(Points=cull_pattern_12, Plane=PlaneXY(0, 0, 0), Ct=0, Cr=0, Rx=True, Ry=False, Rz=True, Tx=True, Ty=True, Tz=True)
support_13 = Support(Points=cull_pattern_13, Plane=PlaneXY(0, 0, 0), Ct=0, Cr=0, Rx=True, Ry=False, Rz=True, Tx=True, Ty=True, Tz=True)
support_14 = Support(Points=cull_pattern_14, Plane=PlaneXY(0, 0, 0), Ct=0, Cr=0, Rx=True, Ry=False, Rz=True, Tx=True, Ty=True, Tz=True)
support_15 = Support(Points=cull_pattern_15, Plane=PlaneXY(0, 0, 0), Ct=0, Cr=0, Rx=True, Ry=False, Rz=True, Tx=True, Ty=True, Tz=True)
support_16 = Support(Points=cull_pattern_16, Plane=PlaneXY(0, 0, 0), Ct=0, Cr=0, Rx=True, Ry=False, Rz=True, Tx=True, Ty=True, Tz=True)
support_17 = Support(Points=cull_pattern_17, Plane=PlaneXY(0, 0, 0), Ct=0, Cr=0, Rx=True, Ry=False, Rz=True, Tx=True, Ty=True, Tz=True)

panel_116 = Panel("""M0.07
M0.08
M0.09
M0.10""")
panel_117 = Panel("""M0.13
M0.15
M0.16
M0.17""")
nature = Slider(0, range=0..4)
nature_2 = Slider(0, range=0..4)
unit_y_30 = UnitY(Factor=expr("-x", "0.56"))
unit_y_31 = UnitY(Factor="0.56")
viento_en_y_1 = UniformLoad(Vector=unit_y_31, Target=panel_116, LCase="Wy1", Nature=nature)
viento_en_y_2 = UniformLoad(Vector=unit_y_30, Target=panel_117, LCase="Wy2", Nature=nature_2)

panel_118 = Panel("""M0.01
M0.02a""")
panel_119 = Panel("""M0.06
M0.04a""")
nature_3 = Slider(0, range=0..4)
nature_4 = Slider(0, range=0..4)
unit_x = UnitX(Factor=expr("-x", "0.67"))
unit_x_2 = UnitX(Factor="0.67")
viento_en_x_1 = UniformLoad(Vector=unit_x_2, Target=panel_118, LCase="Wx1", Nature=nature_3)
viento_en_x_2 = UniformLoad(Vector=unit_x, Target=panel_119, LCase="Wx2", Nature=nature_4)

panel_120 = Panel("""T0.01
T0.02
T0.03
T0.04
T0.05
T0.06
T0.07
T0.08
T0.09
T0.10""")
panel_121 = Panel("""T1.01
T1.02
T1.03
T1.04
T1.05
T1.06
T1.07
T1.08
T1.09
T1.10""")
panel_122 = Panel("""T0.11
T0.12
T0.13
T0.14
T0.15
T0.16
T0.17
T0.18
T0.19""")
nature_5 = Slider(0, range=0..4)
nature_6 = Slider(0, range=0..4)
unit_z_28 = UnitZ(Factor=expr("-x", "1"))
unit_z_29 = UnitZ(Factor=expr("-x", "2"))
sobrecarga_uso = UniformLoad(Vector=unit_z_28, Target=panel_121, LCase="Q1", Nature=nature_5)
sobrecarga_uso_2 = UniformLoad(Vector=unit_z_29, Target=[panel_120, panel_122], LCase="Q1", Nature=nature_6)

relay_10 = Relay([support_12, support_13, support_14, support_15, support_17, support_16, relay_9])

panel_123 = Panel("""M1.04
M1.05""")
panel_124 = Panel("""M1.07
M1.08""")
nature_7 = Slider(0, range=0..4)
nature_8 = Slider(0, range=0..4)
unit_y_32 = UnitY(Factor=expr("-x", "0.59"))
unit_y_33 = UnitY(Factor="0.59")
viento_en_y_1_2 = UniformLoad(Vector=unit_y_33, Target=panel_123, LCase="Wy1", Nature=nature_7)
viento_en_y_2_2 = UniformLoad(Vector=unit_y_32, Target=panel_124, LCase="Wy2", Nature=nature_8)

nature_9 = Slider(0, range=0..4)
nature_10 = Slider(0, range=0..4)
unit_x_3 = UnitX(Factor=expr("-x", "0.7"))
unit_x_4 = UnitX(Factor="0.7")
viento_en_x_1_2 = UniformLoad(Vector=unit_x_4, Target="M1.01", LCase="Wx1", Nature=nature_9)
viento_en_x_2_2 = UniformLoad(Vector=unit_x_3, Target="M1.03", LCase="Wx2", Nature=nature_10)

relay_11 = Relay([viento_en_y_1, viento_en_y_2])
relay_12 = Relay([viento_en_x_1, viento_en_x_2])
material_properties = MaterialProperties(
    FamilyOfMaterial="timber",
    Name="C24",
    E0=12000,
    E90=460,
    GXy=690,
    Α=0.335,
    GXz=690,
    GYz=50,
    Ρₘ=3.5,
    AlphaT1=3.8e-06,
    AlphaT2=1.85e-05,
    Fm0K=24,
    Fm90K=0,
    Ft0K=14.5,
    Ft90K=0.12,
    Fc0K=21,
    Fc90K=2.5,
    FvXzK=4,
    FvXyK=3.5,
    FvNetK=3.9,
    FvTorK=2.5,
    FvYzK=3.5)
relay_13 = Relay([sobrecarga_uso, sobrecarga_uso_2])
relay_14 = Relay([viento_en_y_1_2, viento_en_y_2_2, viento_en_x_1_2, viento_en_x_2_2])
horizontales = Curve([<curve referenced from the Rhino model> x56])
T = Slider(0, range=0..6)
d = Slider(8, range=4..16)
s = Slider(100, range=50..500)
verticales = Curve([<curve referenced from the Rhino model> x26])
T_2 = Slider(0, range=0..6)
d_2 = Slider(8, range=4..16)
s_2 = Slider(100, range=50..500)
line_joint = LineJoint(LineS=horizontales, Type=T, DiameterD=d, SpacingS=s, DensityΡₘ=380, ManualKser=0)  # -> JointData, Info
line_joint_2 = LineJoint(LineS=verticales, Type=T_2, DiameterD=d_2, SpacingS=s_2, DensityΡₘ=380, ManualKser=0)  # -> JointData, Info
relay_15 = Relay([relay_11, relay_13, relay_14, relay_12])
relay_16 = Relay([line_joint_2.JointData, line_joint.JointData])
assemble_model = AssembleModel(ElementS=relay_8, SupportS=relay_10, LoadS=relay_15, JointS=relay_16, MaterialS=material_properties)  # -> Model, Mass, CentreOfGravity
bu = Slider(0, range=0..4)
bu_2 = Slider(0, range=0..4)
bu_3 = Slider(0, range=0..4)
C = Slider(1, range=1..4)
C_2 = Slider(1, range=1..4)
C_3 = Slider(1, range=1..4)
elu_lcase_comb = Panel("""1.35*PP + 1.50*Q1 + 0.90*Wx1
1.35*PP + 1.50*Q1 + 0.90*Wx2
1.35*PP + 1.50*Q1 + 0.90*Wy1
1.35*PP + 1.50*Q1 + 0.90*Wy2
1.35*PP + 1.50*Wx1 + 1.05*Q1
1.35*PP + 1.50*Wx2 + 1.05*Q1
1.35*PP + 1.50*Wy1 + 1.05*Q1
1.35*PP + 1.50*Wy2 + 1.05*Q1
PP + SismoX + 0.3*Q1
PP + SismoY + 0.3*Q1""")
elu_lcase_comb_2 = Panel("""1.35*PP + 1.50*Q1 + 0.90*Wx1
1.35*PP + 1.50*Q1 + 0.90*Wx2
1.35*PP + 1.50*Q1 + 0.90*Wy1
1.35*PP + 1.50*Q1 + 0.90*Wy2
1.35*PP + 1.50*Wx1 + 1.05*Q1
1.35*PP + 1.50*Wx2 + 1.05*Q1
1.35*PP + 1.50*Wy1 + 1.05*Q1
1.35*PP + 1.50*Wy2 + 1.05*Q1""")
seismic_activity = SeismicActivity(LocationAb="Alicante", CoeffKManual=1, SoilTypeC=C, SpecialImportance=False, DuctilityΜ=2, BuildingUse=bu)  # -> SeismicData, Info
seismic_activity_2 = SeismicActivity(LocationAb="Alicante", CoeffKManual=1, SoilTypeC=C_2, SpecialImportance=False, DuctilityΜ=2, BuildingUse=bu_2)  # -> SeismicData, Info
seismic_activity_3 = SeismicActivity(LocationAb="Alicante", CoeffKManual=1, SoilTypeC=C_3, SpecialImportance=False, DuctilityΜ=2, BuildingUse=bu_3)  # -> SeismicData, Info
els_lcase_comb = Panel("""PP + Q1 + 0.6*Wx1
PP + Q1 + 0.6*Wx2
PP + Q1 + 0.6*Wy1
PP + Q1 + 0.6*Wy2
PP + Wx1 + 0.7*Q1
PP + Wx2 + 0.7*Q1
PP + Wy1 + 0.7*Q1
PP + Wy2 + 0.7*Q1""")
write_csv = BooleanToggle(False)
write_csv_2 = BooleanToggle(False)
displacement_solver = DisplacementSolver(Model=assemble_model.Model, LCaseComb=els_lcase_comb, SeismicData=seismic_activity.SeismicData, WriteCSV=write_csv)  # -> AnalysedMesh, AllDisplacements, Log
internal_forces_solver = InternalForcesSolver(LCaseComb=elu_lcase_comb, WriteCSV=Toggle(True))  # -> AnalysedModel, MembraneForcesN, BendingMomentsM, ShearForcesV, PrincipalMembrane, PrincipalBending, Log
internal_stress_solver = InternalStressSolver(Model=assemble_model.Model, LCaseComb=elu_lcase_comb_2, WriteCSV=write_csv_2)  # -> AnalysedModel, TopFaceStresses, BottomFaceStresses, ShearStresses, Log
displacement_viewer = DisplacementViewer(
    AnalysedModel=displacement_solver.AnalysedMesh,
    AllDisplacements=displacement_solver.AllDisplacements,
    ExpCase=True,
    ExpDisp=True,
    ExpVal=True,
    ScaleDef=100,
    SelCase=0,
    ShowAxes=False,
    ShowVal=False,
    TxtSize=12,
    ValThres=0)  # -> DeformedMesh, DeformedAxes
forces_viewer = ForcesViewer(
    AnalysedModel=internal_forces_solver.AnalysedModel,
    MembraneForcesN=internal_forces_solver.MembraneForcesN,
    BendingMomentsM=internal_forces_solver.BendingMomentsM,
    ShearForcesV=internal_forces_solver.ShearForcesV,
    PrincipalMembrane=internal_forces_solver.PrincipalMembrane,
    PrincipalBending=internal_forces_solver.PrincipalBending,
    ExpCase=True,
    ExpComp=True,
    ExpVal=True,
    SelCase=0,
    SelComp=9,
    ShowVal=False,
    TxtSize=12,
    ValThres=0)  # -> VisMesh, LegendValues
stress_viewer = StressViewer(
    Model=internal_stress_solver.AnalysedModel,
    TopFaceStresses=internal_stress_solver.TopFaceStresses,
    BottomFaceStresses=internal_stress_solver.BottomFaceStresses,
    ShearStresses=internal_stress_solver.ShearStresses,
    ExpCase=True,
    ExpComp=False,
    ExpVal=True,
    SelCase=5,
    SelComp=1,
    ShowVal=False,
    TxtSize=12,
    ValThres=0)  # -> StressedMesh, LegendValues
panel_125 = Panel(displacement_solver.Log)
panel_126 = Panel(internal_forces_solver.Log)
panel_127 = Panel(internal_stress_solver.Log)
